vi "DesktopWeb.gvi"   [LabVIEW Platform Developer Preview 0.1.0]
panel controls:
  "Slider": f64 = 80
panel indicators:
  "Chart": f64
  "Blade Speed": f64
  "Wind Speed": f64
  "Numeric": f64
  "Url Image": string
  "Data Grid": T1[]
  "Alarm": bool
  "Numeric_2": f64
types:
  T1 = cluster{"Turbine": string, "Blade Speed": f64, "Power": f64, "Sys Alarm": bool, "Wind Speed": f64, "Direction": f64, "E-Total": f64, "Op Hour": f64, "Location": string, "MB": bool}
diagram:
  while {
    Wait(time to wait=250)
    w1 = [{"Turbine"="BDA 1", "Blade Speed"=30, "Power"=101, "Sys Alarm"=FALSE, "Wind Speed"=19, "Direction"=97, "E-Total"=78456, "Op Hour"=67, "Location"="20, 21", "MB"=FALSE}, {"Turbine"="BDA 2", "Blade Speed"=30, "Power"=104, "Sys Alarm"=FALSE, "Wind Speed"=21, "Direction"=96, "E-Total"=46567, "Op Hour"=1001, "Location"="20, 22", "MB"=FALSE}, {"Turbine"="BDA 3", "Blade Speed"=36, "Power"=103, "Sys Alarm"=FALSE, "Wind Speed"=21, "Direction"=97, "E-Total"=56729, "Op Hour"=78, "Location"="20, 23", "MB"=FALSE}, {"Turbine"="BDA 4", "Blade Speed"=35, "Power"=100, "Sys Alarm"=FALSE, "Wind Speed"=21, "Direction"=96, "E-Total"=46523, "Op Hour"=998, "Location"="20, 24", "MB"=FALSE}, {"Turbine"="BDA 5", "Blade Speed"=35, "Power"=100, "Sys Alarm"=FALSE, "Wind Speed"=18, "Direction"=98, "E-Total"=78965, "Op Hour"=1321, "Location"="21, 21", "MB"=FALSE}, {"Turbine"="BDA 6", "Blade Speed"=33, "Power"=99, "Sys Alarm"=FALSE, "Wind Speed"=19, "Direction"=96, "E-Total"=43567, "Op Hour"=995, "Location"="21, 22", "MB"=FALSE}, {"Turbine"="FRD 1", "Blade Speed"=30, "Power"=97, "Sys Alarm"=FALSE, "Wind Speed"=18, "Direction"=95, "E-Total"=34235, "Op Hour"=567, "Location"="30, 34", "MB"=FALSE}, {"Turbine"="FRD 2", "Blade Speed"=32, "Power"=101, "Sys Alarm"=FALSE, "Wind Speed"=21, "Direction"=97, "E-Total"=74342, "Op Hour"=986, "Location"="30, 35", "MB"=FALSE}]
    $"Data Grid" <- w1
    Divide(x=$Slider, y=10) -> w2
    Random Number() -> (number (0 to 1)=w3)
    Add(100, w3) -> w4
    Subtract(x=w4, y=w2) -> w5
    Divide(x=w5, y=w2) -> w6
    Is Greater(x=w6, y=60) -> w7
    $Alarm <- w7
    $"Blade Speed" <- w6
    $Numeric_2 <- w6
    Divide(x=w5, y=4) -> w8
    $"Wind Speed" <- w8
    $Numeric <- w8
    $Chart <- w5
    stop if FALSE
  }
